# Dynamo graph PDFexport_R23.dyn "PDFexport_R23_beta" (Dynamo 2.16.2.5624)
# packages: Orchid 2.16.4.6169

# group: Merge PDF files
code_block = CodeBlock()
# ---------- code_block.designscript (6 lines) ----------
//input documents
["%userprofile%\\Downloads\\PDF\\pdf1.pdf",
"%userprofile%\\Downloads\\PDF\\pdf2.pdf"];

//output file path
"%userprofile%\\Downloads\\PDF\\result.pdf";
# ----------------------------------------
mergePDF = Orchid.Common.File.MergePDF(documents=code_block.out0, filePath=code_block.out1)  # frozen

paperSize = Orchid.Common.PDFexport.PaperSize()
watch = Watch(paperSize)

# group: filePath --> file name incl. path
sheet_set = SheetSet("A3 set")  # graph input
boolean = BoolSelector(false)  # graph input
name = Orchid.RevitProject.Common.Document.Name()
pdfexport_quality = ExportQuality("DPI1200")
byViewSheetSet = Orchid.Common.PDFexport.ByViewSheetSet(viewSheetSet=sheet_set, combine=boolean, fileName=name, exportQuality=pdfexport_quality)
getView = Orchid.RevitProject.Views.SheetSet.GetView(viewSheetSet=sheet_set)
byView = Orchid.Common.PDFexport.ByView(view=getView, combine=boolean, fileName=name)  # frozen

# group: SheetSet
code_block_2 = CodeBlock { "Sheets"; }  # frozen
byName = Category.ByName(name=code_block_2)
all_elements_of_category = ElementsOfCategory(Category=byName)
string = StringInput("testSet")  # graph input
create = Orchid.RevitProject.Views.SheetSet.Create(view=all_elements_of_category, name=string)
delete = Orchid.RevitProject.Views.SheetSet.Delete(viewSheetSet=create)  # frozen
getView_2 = Orchid.RevitProject.Views.SheetSet.GetView(viewSheetSet=create)
sheet_set_2 = SheetSet("A3 set")  # graph input
change = Orchid.RevitProject.Views.SheetSet.Change(view=getView_2, viewSheetSet=sheet_set_2)

# group: Print current view (center and fit to page)
string_2 = StringInput("testSetting2")  # graph input; frozen
pdfexport_papersizes = PaperSize("<Use Sheet Size>")
print_paperplacement = PaperPlacement("Center")  # graph input
print_zoomtype = ZoomType("Fit To Page")  # graph input
createSetting = Orchid.Common.PDFexport.CreateSetting(name=string_2, paperZize=pdfexport_papersizes, paperPlacement=print_paperplacement, zoomType=print_zoomtype)
activeView = Orchid.RevitProject.Common.Document.ActiveView()
# note: if export options there are rarely set need to be included, then connect:
# "Export.SetOptions" output ExportSetting to "Export.ByView" input exportSetting!
byView_2 = Orchid.Common.PDFexport.ByView(pathName=activeView, exportSetting=createSetting)
await_ = Orchid.Common.DataStream.Await(pass=createSetting, waitFor=byView_2)
deleteSetting = Orchid.Common.PDFexport.DeleteSetting(exportSetting=await_)

# group: Print options there are rarely set
boolean_2 = BoolSelector(true)  # graph input
boolean_3 = BoolSelector(false)  # graph input
print_rasterquality = RasterQuality("Medium")
print_colordepth = ColorDepthType("Gray Scale")  # graph input
setOptions = Orchid.Common.PDFexport.SetOptions(exportSetting=createSetting, viewLinksinBlue=boolean_2, hideReforWorkPlanes=boolean_3, hideUnreferencedViewTags=boolean_2, maskCoincidentLines=boolean_2, hideScopeBoxes=boolean_3, hideCropBoundaries=boolean_3, replaceHalftoneWithThinLines=boolean_2, createOutputUsing=boolean_2, rasterQuality=print_rasterquality, colorDepth=print_colordepth)  # frozen

string_3 = StringInput("testSetting")  # graph input
createSetting_2 = Orchid.Common.PDFexport.CreateSetting(name=string_3)
pdfexport_paper_sizes = PaperSize("ISO A3 : 297x420 mm")
print_page_orientation = PageOrientation("Portrait")  # graph input
print_paperplacement_2 = PaperPlacement("Lower Left")  # graph input
print_margin_type = MarginType("User defined")  # graph input
code_block_3 = CodeBlock { [10,10]; }
print_zoom_type = ZoomType("Zoom")  # graph input
code_block_4 = CodeBlock { 100; }
changeSetting = Orchid.Common.PDFexport.ChangeSetting(exportSetting=createSetting_2, paperZize=pdfexport_paper_sizes, pageOrientation=print_page_orientation, paperPlacement=print_paperplacement_2, marginType=print_margin_type, margin=code_block_3, zoomType=print_zoom_type, zoom=code_block_4)  # frozen

# group: Remove print setting
string_4 = StringInput("testSetting")  # graph input
byName_2 = Orchid.Common.PDFexport.ByName(name=string_4)
watch_2 = Watch(byName_2)
pdfexport_settings = Setting("testSetting")
deleteSetting_2 = Orchid.Common.PDFexport.DeleteSetting(exportSetting=byName_2)  # frozen
