# Dynamo graph Selection.dyn (Dynamo 2.12.1.8246)
# packages: Orchid 216.3.0.5794

natural_category_name = CodeBlock()
# ---------- natural_category_name.designscript (26 lines) ----------
[
"Casework",
"Ceilings",
"Columns",
"Curtain Wall Mullions",
"Curtain Panels",
"Curtain Systems",
"Doors",
"Entourage",
"Floors",
"Furniture",
"Furniture Systems",
"Generic Models",
"Plumbing Fixtures",
"Ramps",
"Roofs",
"Specialty Equipment",
"Stairs",
"Structural Columns",
"Structural Foundations",
"Structural Framing",
"Structural Beam Systems",
"Structural Stiffeners",
"Walls",
"Windows"
];
# ----------------------------------------

# group: Selection by element
byName = Category.ByName(name=natural_category_name)
byCategory = Orchid.RevitProject.Elements.Element.ByCategory(category=byName)
watch = Watch(byCategory.d1)
watch_2 = Watch(byCategory.Element)
hasMaterial = Orchid.RevitProject.Elements.Element.HasMaterial()
watch_3 = Watch(hasMaterial.Element)
watch_4 = Watch(hasMaterial.Category)

code_block = CodeBlock()
# ---------- code_block.designscript (9 lines) ----------
"Model";
"Annotation";
"AnalyticalModel";
"Internal";

["Model",
"Annotation",
"AnalyticalModel",
"Internal"];
# ----------------------------------------

# group: Selection by element type
boolean = BoolSelector(false)
byCategoryType = Orchid.RevitProject.Elements.ElementType.ByCategoryType(categoryType=code_block.out0, condense=boolean)
watch_5 = Watch(byCategoryType.ElementType)
watch_6 = Watch(byCategoryType.CategoryType)
watch_7 = Watch(byCategoryType.Category)

# group: Selection by element
byCategoryType_2 = Orchid.RevitProject.Elements.Element.ByCategoryType(categoryType=code_block.out0)
watch_8 = Watch(byCategoryType_2.Element)
watch_9 = Watch(byCategoryType_2.Category)
watch_10 = Watch(byCategoryType_2.CategoryType)

# group: Selection by level
levels = Levels("Level 1")
boolean_2 = BoolSelector(true)
byLevel = Orchid.RevitProject.Elements.Element.ByLevel(categoryType=levels, spatial=boolean_2)
watch_11 = Watch(byLevel.Category)
watch_12 = Watch(byLevel.Element)

# group: Model elements
modelElement = Orchid.RevitProject.Elements.Element.ModelElement()
watch_13 = Watch(modelElement.Category)
watch_14 = Watch(modelElement.Element)

# group: Family
inDocument = Orchid.RevitProject.Elements.Family.InDocument()
watch_15 = Watch(inDocument.Category)
watch_16 = Watch(inDocument.Family)
code_block_2 = CodeBlock()
# ---------- code_block_2.designscript (2 lines) ----------
["Doors",
"Windows"];
# ----------------------------------------
byName_2 = Category.ByName(name=code_block_2)
byCategory_2 = Orchid.RevitProject.Elements.Family.ByCategory(category=byName_2)
watch_17 = Watch(byCategory_2)

# group: OOTB nodes
byName_3 = Category.ByName(name=natural_category_name)
all_elements_of_category = ElementsOfCategory(Category=byName_3)
clean = Orchid.Common.List.Clean(list=all_elements_of_category)
watch_18 = Watch(clean)

# group: Selection by element type
boolean_3 = BoolSelector(false)
hasMaterial_2 = Orchid.RevitProject.Elements.ElementType.HasMaterial(condense=boolean_3)
watch_19 = Watch(hasMaterial_2.Category)
watch_20 = Watch(hasMaterial_2.ElementType)

# group: FamilyType
inDocument_2 = Orchid.RevitProject.Elements.FamilyType.InDocument()
watch_21 = Watch(inDocument_2.FamilyType)
watch_22 = Watch(inDocument_2.Category)
code_block_3 = CodeBlock()  # same code as code_block_2
byCategory_3 = Orchid.RevitProject.Elements.FamilyType.ByCategory(category=code_block_3)
watch_23 = Watch(byCategory_3)

code_block_4 = CodeBlock()
# ---------- code_block_4.designscript (3 lines) ----------
["Rooms",
"Spaces",
"Areas"];
# ----------------------------------------
built_in_categories = CodeBlock()
# ---------- built_in_categories.designscript (26 lines) ----------
[
"OST_Casework",
"OST_Ceilings",
"OST_Columns",
"OST_CurtainWallMullions",
"OST_CurtainWallPanels",
"OST_CurtaSystem",
"OST_Doors",
"OST_Entourage",
"OST_Floors",
"OST_Furniture",
"OST_FurnitureSystems",
"OST_GenericModel",
"OST_PlumbingFixtures",
"OST_Ramps",
"OST_Roofs",
"OST_SpecialityEquipment",
"OST_Stairs",
"OST_StructuralColumns",
"OST_StructuralFoundation",
"OST_StructuralFraming",
"OST_StructuralFramingSystem",
"OST_StructuralStiffener",
"OST_Walls",
"OST_Windows"
];
# ----------------------------------------

# group: Converters
toRevitType = Orchid.Common.Object.ToRevitType(object=byName_3)
toDynamoType = Orchid.Common.Object.ToDynamoType(object=toRevitType)
watch_24 = Watch(toDynamoType)
type = Object.Type(object=toDynamoType)
watch_25 = Watch(type)

# group: Converters Note: FamilyType in a project document is denoted FamilySymbol in Autodesk Revit API!
toRevitType_2 = Orchid.Common.Object.ToRevitType(object=byCategory_3)
watch_26 = Watch(toRevitType_2)
toDynamoType_2 = Orchid.Common.Object.ToDynamoType(object=toRevitType_2)
watch_27 = Watch(toDynamoType_2)
name = Element.Name(element=toDynamoType_2)
watch_28 = Watch(name)

# group: Selection
byFamily = Orchid.RevitProject.Elements.Element.ByFamily(family=byCategory_2)
watch_29 = Watch(byFamily)
