# Dynamo graph SpatialElement.dyn (Dynamo 2.16.1.2727)
# packages: Orchid 216.3.0.5799

# group: Get boundary curves by specific boundary
code_block = CodeBlock { "Rooms"; "Spaces"; }
byName = Category.ByName(name=code_block.out0)
byCategory = Orchid.RevitProject.Elements.Element.ByCategory(category=byName)
coreBoundary = Orchid.RevitProject.Elements.SpatialElement.CoreBoundary(spatialElement=byCategory.Element)
coreCenterBoundary = Orchid.RevitProject.Elements.SpatialElement.CoreCenterBoundary(spatialElement=byCategory.Element)
finishBoundary = Orchid.RevitProject.Elements.SpatialElement.FinishBoundary(spatialElement=byCategory.Element)
watch = Watch(finishBoundary.Element)
centerBoundary = Orchid.RevitProject.Elements.SpatialElement.CenterBoundary(spatialElement=byCategory.Element)
watch_2 = Watch(centerBoundary.Element)
watch_3 = Watch(finishBoundary.Curve)
watch_4 = Watch(centerBoundary.Curve)

# group: Get boundary curves
code_block_2 = CodeBlock { "Room"; "Space"; "Area"; }
inDocument = Orchid.RevitProject.Elements.SpatialElement.InDocument(spatialType=code_block_2.out0)
boundary = Orchid.RevitProject.Elements.SpatialElement.Boundary(spatialElement=inDocument)
watch_5 = Watch(boundary.Curve)
watch_6 = Watch(boundary.Element)
getSeparationLine = Orchid.RevitProject.Elements.SpatialElement.GetSeparationLine(spatialElement=inDocument)
watch_7 = Watch(getSeparationLine.Curve)
watch_8 = Watch(getSeparationLine.Element)

# group: Change state for volume computation
boolean = BoolSelector(true)
volumeComputation = Orchid.RevitProject.Common.Document.VolumeComputation(state=boolean)

# group: Revit links
getRevitLink = Orchid.RevitProject.Common.Link.GetRevitLink()
instance = Orchid.RevitProject.Common.Link.Instance(link=getRevitLink)
document = Orchid.RevitProject.Common.Link.Document(instance=instance)
code_block_3 = CodeBlock { "Rooms"; "Spaces"; "Areas"; }
byName_2 = Category.ByName(name=code_block_3.out0)
byCategory_2 = Orchid.RevitProject.Elements.Element.ByCategory(document=document, category=byName_2)
getSeparationLine_2 = Orchid.RevitProject.Elements.SpatialElement.GetSeparationLine(document=document, spatialElement=byCategory_2.Element)
watch_9 = Watch(getSeparationLine_2.Curve)
watch_10 = Watch(getSeparationLine_2.Element)
boundary_2 = Orchid.RevitProject.Elements.SpatialElement.Boundary(document=document, spatialElement=byCategory_2.Element)
watch_11 = Watch(boundary_2.Curve)
watch_12 = Watch(boundary_2.Element)

# group: Spatial Elements
inDocument_2 = Orchid.RevitProject.Elements.SpatialElement.InDocument()
watch_13 = Watch(inDocument_2)
code_block_4 = CodeBlock { "Room"; "Space"; "Area"; }
inDocument_3 = Orchid.RevitProject.Elements.SpatialElement.InDocument(spatialType=code_block_4.out0)
watch_14 = Watch(inDocument_3)

# group: Boundary conditions
spatialelement_boundarylocation = SpatialElementBoundaryLocation("Finish")
spatialelement_type = SpatialElementType("Room")
setBoundaryConditions = Orchid.RevitProject.Elements.SpatialElement.SetBoundaryConditions(boundaryLocation=spatialelement_boundarylocation, spatialType=spatialelement_type)

# group: Inside spatial element?
code_block_5 = CodeBlock { "Room"; "Space"; "Area"; 500; }
inDocument_4 = Orchid.RevitProject.Elements.SpatialElement.InDocument(spatialType=code_block_5.out1)
byCoordinates = Point.ByCoordinates(x=code_block_5.out3, y=code_block_5.out3, z=code_block_5.out3)
isInsideSpace = Orchid.RevitProject.Elements.SpatialElement.IsInsideSpace(space=inDocument_4, point=byCoordinates)
watch_15 = Watch(isInsideSpace)
inDocument_5 = Orchid.RevitProject.Elements.SpatialElement.InDocument(spatialType=code_block_5.out0)
isInsideRoom = Orchid.RevitProject.Elements.SpatialElement.IsInsideRoom(room=inDocument_5, point=byCoordinates)
watch_16 = Watch(isInsideRoom)

# group: Name, number, and location
code_block_6 = CodeBlock { "Room"; "Space"; "Area"; }
inDocument_6 = Orchid.RevitProject.Elements.SpatialElement.InDocument(spatialType=code_block_6.out0)
centerLocation = Orchid.RevitProject.Elements.SpatialElement.CenterLocation(spatialElement=inDocument_6)
location = Orchid.RevitProject.Elements.SpatialElement.Location(spatialElement=centerLocation)
watch_17 = Watch(location)
code_block_7 = CodeBlock { a = "Room "; b = 1..4; a+b; 101..104; }
setName = Orchid.RevitProject.Elements.SpatialElement.SetName(spatialElement=inDocument_6, value=code_block_7.out2)
name = Orchid.RevitProject.Elements.SpatialElement.Name(spatialElement=setName)
watch_18 = Watch(name)
string_from_object = FromObject(object=code_block_7.out3)
setNumber = Orchid.RevitProject.Elements.SpatialElement.SetNumber(spatialElement=inDocument_6, value=string_from_object)
number = Orchid.RevitProject.Elements.SpatialElement.Number(spatialElement=setNumber)
watch_19 = Watch(number)

# group: Height, area, volume, and phase
code_block_8 = CodeBlock { "Room"; "Space"; "Area"; }
inDocument_7 = Orchid.RevitProject.Elements.SpatialElement.InDocument(spatialType=code_block_8.out1)
height = Orchid.RevitProject.Elements.SpatialElement.Height(spatialElement=inDocument_7)
watch_20 = Watch(height)
area = Orchid.RevitProject.Elements.SpatialElement.Area(spatialElement=inDocument_7)
watch_21 = Watch(area)
volume = Orchid.RevitProject.Elements.SpatialElement.Volume(spatialElement=inDocument_7)
watch_22 = Watch(volume)
phase = Orchid.RevitProject.Elements.SpatialElement.Phase(spatialElement=inDocument_7)
watch_23 = Watch(phase)
