# Dynamo graph Workset.dyn (Dynamo 2.16.1.2727)
# packages: Orchid 216.3.0.8442

# group: Selection
code_block = CodeBlock()
# ---------- code_block.designscript (9 lines) ----------
"Model";
"Annotation";
"AnalyticalModel";
"Internal";

["Model",
"Annotation",
"AnalyticalModel",
"Internal"];
# ----------------------------------------
elementByCategoryType = Orchid.RevitProject.Elements.Selection.ElementByCategoryType(categoryType=code_block.out0)
code_block_2 = CodeBlock { "Workset Text"; }
getWorkset = Orchid.RevitProject.Elements.Element.GetWorkset(element=elementByCategoryType.Element)
name = Orchid.RevitProject.Common.Workset.Name(workset=getWorkset)
setParameterByName = Element.SetParameterByName(element=elementByCategoryType.Element, parameterName=code_block_2, value=name)

# group: Selection
elementHasMaterial = Orchid.RevitProject.Elements.Selection.ElementHasMaterial()
code_block_3 = CodeBlock { "Workset Text"; }
getWorkset_2 = Orchid.RevitProject.Elements.Element.GetWorkset(element=elementHasMaterial.Element)
name_2 = Orchid.RevitProject.Common.Workset.Name(workset=getWorkset_2)
setParameterByName_2 = Element.SetParameterByName(element=elementHasMaterial.Element, parameterName=code_block_3, value=name_2)

userWorkset = Orchid.RevitProject.Common.Workset.UserWorkset()
name_3 = Orchid.RevitProject.Common.Workset.Name(workset=userWorkset)
byName = Orchid.RevitProject.Common.Workset.ByName(name=name_3)
watch = Watch(byName)
id = Orchid.RevitProject.Common.Workset.Id(workset=userWorkset)
watch_2 = Watch(id)
watch_3 = Watch(name_3)
byId = Orchid.RevitProject.Common.Workset.ById(id=id)
watch_4 = Watch(byId)
watch_5 = Watch(userWorkset)
uniqueId = Orchid.RevitProject.Common.Workset.UniqueId(workset=userWorkset)
watch_6 = Watch(uniqueId)
all = Orchid.RevitProject.Common.Workset.InDocument()  # "Workset.All"

# group: Selection
natural_category_name = CodeBlock()
# ---------- natural_category_name.designscript (26 lines) ----------
[
"Casework",
"Ceilings",
"Columns",
"Curtain Wall Mullions",
"Curtain Panels",
"Curtain Systems",
"Doors",
"Entourage",
"Floors",
"Furniture",
"Furniture Systems",
"Generic Models",
"Plumbing Fixtures",
"Ramps",
"Roofs",
"Specialty Equipment",
"Stairs",
"Structural Columns",
"Structural Foundations",
"Structural Framing",
"Structural Beam Systems",
"Structural Stiffeners",
"Walls",
"Windows"
];
# ----------------------------------------
byName_2 = Category.ByName(name=natural_category_name)
elementByCategory = Orchid.RevitProject.Elements.Selection.ElementByCategory(category=byName_2)
code_block_4 = CodeBlock { "Workset Text"; }
getWorkset_3 = Orchid.RevitProject.Elements.Element.GetWorkset(element=elementByCategory.Element)
name_4 = Orchid.RevitProject.Common.Workset.Name(workset=getWorkset_3)
setParameterByName_3 = Element.SetParameterByName(element=elementByCategory.Element, parameterName=code_block_4, value=name_4)
built_in_categories = CodeBlock()
# ---------- built_in_categories.designscript (26 lines) ----------
[
"OST_Casework",
"OST_Ceilings",
"OST_Columns",
"OST_CurtainWallMullions",
"OST_CurtainWallPanels",
"OST_CurtaSystem",
"OST_Doors",
"OST_Entourage",
"OST_Floors",
"OST_Furniture",
"OST_FurnitureSystems",
"OST_GenericModel",
"OST_PlumbingFixtures",
"OST_Ramps",
"OST_Roofs",
"OST_SpecialityEquipment",
"OST_Stairs",
"OST_StructuralColumns",
"OST_StructuralFoundation",
"OST_StructuralFraming",
"OST_StructuralFramingSystem",
"OST_StructuralStiffener",
"OST_Walls",
"OST_Windows"
];
# ----------------------------------------

# group: Worksets
worksets = Workset("View \"3D View: {3D}\"")  # graph input
watch_7 = Watch(worksets)
userWorksets = UserWorkset("Shell and Core")
watch_8 = Watch(userWorksets)

# group: SetOwner and Relinquish
boolean = BoolSelector(true)
relinquish = Orchid.RevitProject.Elements.Element.Relinquish(waitFor=boolean)
watch_9 = Watch(relinquish)
userWorkset_2 = Orchid.RevitProject.Common.Workset.UserWorkset()
setOwner = Orchid.RevitProject.Common.Workset.SetOwner(workset=userWorkset_2)
relinquish_2 = Orchid.RevitProject.Common.Workset.Relinquish(waitFor=setOwner)
watch_10 = Watch(relinquish_2)

code_block_5 = CodeBlock { "Walls"; }
byName_3 = Category.ByName(name=code_block_5)
all_elements_of_category = ElementsOfCategory(Category=byName_3)
getWorkset_4 = Orchid.RevitProject.Elements.Element.GetWorkset(element=all_elements_of_category)
watch_11 = Watch(getWorkset_4)
code_block_6 = CodeBlock { "something"; }
create = Orchid.RevitProject.Common.Workset.Create(name=code_block_6)
await_ = Orchid.Common.DataStream.Await(pass=code_block_6, waitFor=create)
byName_4 = Orchid.RevitProject.Common.Workset.ByName(name=await_)
setWorkset = Orchid.RevitProject.Elements.Element.SetWorkset(element=all_elements_of_category, workset=byName_4)

# group: Convert to Orchid type
userWorkset_3 = Orchid.RevitProject.Common.Workset.UserWorkset()
toRevitType = Orchid.Common.Object.ToRevitType(object=userWorkset_3)
toOrchidType = Orchid.Common.Object.ToOrchidType(object=toRevitType)
name_5 = Orchid.RevitProject.Common.Workset.Name(workset=toOrchidType)
watch_12 = Watch(name_5)
