# Dynamo graph NestedByCategory.dyn (Dynamo 2.16.1.2727)
# packages: Orchid 216.3.0.5794

# note: File: defaultFamily
code_block = CodeBlock { "Level Heads"; }
byName = Category.ByName(name=code_block)
getNestedByCategory = Orchid.RevitFamily.Family.GetNestedByCategory(category=byName)
watch = Watch(getNestedByCategory)
getNested = Orchid.RevitFamily.Family.GetNested()
watch_2 = Watch(getNested.Family)
watch_3 = Watch(getNested.Category)
