# Dynamo graph Physical-Thermal-Concrete_R23.dyn (Dynamo 2.16.1.2727)
# packages: Orchid 216.3.0.5828

# group: Create material: Concrete (C30)
# File: defaultProject
boolean = BoolSelector(true)  # graph input
code_block = CodeBlock { "_Concrete"; }
physical_type = PhysicalType("Concrete")  # graph input
create = Orchid.RevitMaterial.Physical.Create(name=code_block, type=physical_type)
code_block_2 = CodeBlock()
# ---------- code_block_2.designscript (6 lines) ----------
"Concrete f'c=30 MPa";
"structural,concrete,CC:BS 8110";
"thermal,solid";
"Concrete";
"Orchid generated";
"https://github.com/erfajo/OrchidForDynamo";
# ----------------------------------------
setInformation = Orchid.RevitMaterial.Physical.SetInformation(propertySet=create, description=code_block_2.out0, keywords=code_block_2.out1, subclass=code_block_2.out3, source=code_block_2.out4, sourceUrl=code_block_2.out5)
physical_behavior = PhysicalBehavior("Isotropic")  # graph input
setBehavior = Orchid.RevitMaterial.Physical.SetBehavior(propertySet=setInformation, behavior=physical_behavior)
thermal_type = ThermalType("Solid")  # graph input
create_2 = Orchid.RevitMaterial.Thermal.Create(name=code_block, type=thermal_type)
setInformation_2 = Orchid.RevitMaterial.Thermal.SetInformation(propertySet=create_2, description=code_block_2.out0, keywords=code_block_2.out2, subclass=code_block_2.out3, source=code_block_2.out4, sourceUrl=code_block_2.out5)
code_block_3 = CodeBlock { 0.00001; }
setBasicThermal = Orchid.RevitMaterial.Physical.SetBasicThermal(propertySet=setBehavior, expansionCoefficient=code_block_3)
code_block_4 = CodeBlock { 20500; 0.2; 11200; 2406.45; }
setMechanical = Orchid.RevitMaterial.Physical.SetMechanical(propertySet=setBasicThermal, youngModulus=code_block_4.out0, poissonRatio=code_block_4.out1, shearModulus=code_block_4.out2, density=code_block_4.out3)
boolean_2 = BoolSelector(false)  # graph input
physical_behavior_2 = PhysicalBehavior("Isotropic")  # graph input
code_block_5 = CodeBlock { 1.046; 0.657; 2300; 0.95; 182.4; 0.01; 0; 2000000; }
setProperties = Orchid.RevitMaterial.Thermal.SetProperties(propertySet=setInformation_2, transmitsLight=boolean_2, behavior=physical_behavior_2, thermalConductivity=code_block_5.out0, specificHeat=code_block_5.out1, density=code_block_5.out2, emissivity=code_block_5.out3, permeability=code_block_5.out4, porosity=code_block_5.out5, reflectivity=code_block_5.out6, electricalResistivity=code_block_5.out7)
create_3 = Orchid.RevitMaterial.Material.Create(name=code_block)
material_aspect = MaterialAspect("Thermal")  # graph input
setThermal = Orchid.RevitMaterial.Material.SetThermal(material=create_3, aspect=material_aspect, propertySet=setProperties)
name = Material.Name(material=setThermal)
watch = Watch(name)
watch_2 = Watch(setThermal)
material_aspect_2 = MaterialAspect("Physical (Structural)")  # graph input
code_block_6 = CodeBlock { 30.0; 1.0; }
boolean_3 = BoolSelector(false)  # graph input
setConcrete = Orchid.RevitMaterial.Physical.SetConcrete(propertySet=setMechanical, compression=code_block_6.out0, shearStrengthReduction=code_block_6.out1, lightweight=boolean_3)
setPhysical = Orchid.RevitMaterial.Material.SetPhysical(material=create_3, aspect=material_aspect_2, propertySet=setConcrete)
name_2 = Material.Name(material=setPhysical)
watch_3 = Watch(name_2)
watch_4 = Watch(setPhysical)

getInformation = Orchid.RevitMaterial.Physical.GetInformation(propertySet=setInformation)
watch_5 = Watch(getInformation.Keywords)
watch_6 = Watch(getInformation.Subclass)
watch_7 = Watch(getInformation.Source)
watch_8 = Watch(getInformation.SourceUrl)
getBehavior = Orchid.RevitMaterial.Physical.GetBehavior(propertySet=setBehavior)
watch_9 = Watch(getBehavior)
watch_10 = Watch(getInformation.Description)
getInformation_2 = Orchid.RevitMaterial.Thermal.GetInformation(propertySet=setInformation_2)
watch_11 = Watch(getInformation_2.SourceUrl)
watch_12 = Watch(getInformation_2.Source)
watch_13 = Watch(getInformation_2.Subclass)
watch_14 = Watch(getInformation_2.Keywords)
watch_15 = Watch(getInformation_2.Description)
getYoungModulus = Orchid.RevitMaterial.Physical.GetYoungModulus(propertySet=setMechanical)
watch_16 = Watch(getYoungModulus.YoungModulusX)
watch_17 = Watch(getYoungModulus.YoungModulusY)
watch_18 = Watch(getYoungModulus.YoungModulusZ)
watch_19 = Watch(getYoungModulus.YoungModulus1)
watch_20 = Watch(getYoungModulus.YoungModulus2)
getExpansionCoefficient = Orchid.RevitMaterial.Physical.GetExpansionCoefficient(propertySet=setBasicThermal)
watch_21 = Watch(getExpansionCoefficient.ExpansionCoefficientX)
watch_22 = Watch(getExpansionCoefficient.ExpansionCoefficientY)
watch_23 = Watch(getExpansionCoefficient.ExpansionCoefficientZ)
watch_24 = Watch(getExpansionCoefficient.ExpansionCoefficient1)
watch_25 = Watch(getExpansionCoefficient.ExpansionCoefficient2)
watch_26 = Watch(getYoungModulus.YoungModulus)
watch_27 = Watch(getExpansionCoefficient.ExpansionCoefficient)
getProperties = Orchid.RevitMaterial.Thermal.GetProperties(propertySet=setProperties)
watch_28 = Watch(getProperties.ThermalConductivity)
watch_29 = Watch(getProperties.SpecificHeat)
watch_30 = Watch(getProperties.Density)
watch_31 = Watch(getProperties.Behavior)
watch_32 = Watch(getProperties.TransmitsLight)
getPoissonRatio = Orchid.RevitMaterial.Physical.GetPoissonRatio(propertySet=setMechanical)
watch_33 = Watch(getPoissonRatio.PoissonRatioX)
watch_34 = Watch(getPoissonRatio.PoissonRatioY)
watch_35 = Watch(getPoissonRatio.PoissonRatioZ)
watch_36 = Watch(getPoissonRatio.PoissonRatio12)
watch_37 = Watch(getPoissonRatio.PoissonRatio23)
watch_38 = Watch(getProperties.ElectricalResistivity)
watch_39 = Watch(getProperties.Reflectivity)
watch_40 = Watch(getProperties.Porosity)
watch_41 = Watch(getProperties.Permeability)
watch_42 = Watch(getProperties.Emissivity)
watch_43 = Watch(getPoissonRatio.PoissonRatio)
getShearModulus = Orchid.RevitMaterial.Physical.GetShearModulus(propertySet=setMechanical)
watch_44 = Watch(getShearModulus.ShearModulusX)
watch_45 = Watch(getShearModulus.ShearModulusY)
watch_46 = Watch(getShearModulus.ShearModulus)
watch_47 = Watch(getShearModulus.ShearModulusZ)
watch_48 = Watch(getShearModulus.ShearModulus12)
getConcrete = Orchid.RevitMaterial.Physical.GetConcrete(propertySet=setConcrete)
watch_49 = Watch(getConcrete.ShearStrengthReduction)
watch_50 = Watch(getConcrete.Lightweight)
watch_51 = Watch(getConcrete.Compression)
