# Dynamo graph Form.dyn (Dynamo 2.16.1.2727)
# packages: Orchid 216.3.0.5799

element_types = ElementTypes("Extrusion")  # graph input
all_elements_of_type = ElementsOfType(element_type=element_types)
solids = Element.Solids(element=all_elements_of_type)
watch = Watch(solids)
solid = Orchid.Geometry.Form.Solid(form=all_elements_of_type)
watch_2 = Watch(solid)

# group: Dynamo Solid
get = Orchid.Geometry.Form.Get()
solid_2 = Orchid.Geometry.Form.Solid(form=get)
watch_3 = Watch(solid_2)
intersect = Orchid.Geometry.Solid.Intersect(solid=solid_2)
watch_4 = Watch(intersect)

# group: Orchid Solid
get_2 = Orchid.Geometry.Form.Get()
ocSolid = Orchid.Geometry.Form.OcSolid(form=get_2)
intersect_2 = Orchid.Geometry.OcSolid.Intersect(ocSolid=ocSolid)
watch_5 = Watch(intersect_2)
watch_6 = Watch(ocSolid)
union = Orchid.Geometry.OcSolid.Union(ocSolid=ocSolid)
area = Orchid.Geometry.OcSolid.Area(ocSolid=union)
watch_7 = Watch(area)
volumne = Orchid.Geometry.OcSolid.Volumne(ocSolid=union)
watch_8 = Watch(volumne)
watch_9 = Watch(union)
toDynamoType = Orchid.Geometry.OcSolid.ToDynamoType(ocSolid=union)
watch_10 = Watch(toDynamoType)

byUnion = Solid.ByUnion(solids=solid_2)

# group (continued): Dynamo Solid
area_2 = Solid.Area(solid=byUnion)
watch_11 = Watch(area_2)
volume = Solid.Volume(solid=byUnion)
watch_12 = Watch(volume)
watch_13 = Watch(byUnion)
toOrchidType = Orchid.Geometry.Solid.ToOrchidType(solid=byUnion)
watch_14 = Watch(toOrchidType)

element_types_2 = ElementTypes("FreeFormElement")  # graph input
