# Dynamo graph LinkedDocument-pin.dyn (Dynamo 2.16.1.2727)
# packages: Orchid 216.3.0.5799

string = StringInput(".\defaultProject_2020.rvt")  # graph input
backgroundOpen = Orchid.RevitProject.Common.Document.BackgroundOpen(file=string)
pin = Orchid.RevitProject.Elements.Element.Pin(element=backgroundOpen)
await_ = Orchid.Common.DataStream.Await(pass=backgroundOpen, waitFor=pin)
name = Orchid.RevitProject.Common.Document.Name(document=backgroundOpen)
code_block = CodeBlock(name=name) { name+"_copy.rvt"; true; }
saveAs = Orchid.RevitProject.Common.Document.SaveAs(document=await_, name=code_block.out0, overwrite=code_block.out1)
close = Orchid.RevitProject.Common.Document.Close(document=saveAs)

# group: Link revit file
string_2 = StringInput(".\defaultBuilding_2020.rvt")  # graph input
link_positioning = Positioning("Origin")  # graph input
code_block_2 = CodeBlock { 10000; }
byCoordinates = Point.ByCoordinates(y=code_block_2)
attachment_type = AttachmentType("Overlay")  # graph input
path_types = PathType("Relative")
setRevitFile = Orchid.RevitProject.Common.Link.SetRevitFile(document=backgroundOpen, file=string_2, positioning=link_positioning, referencePoint=byCoordinates, attachmentType=attachment_type, pathType=path_types)

watch = Watch(setRevitFile.Instance)
watch_2 = Watch(setRevitFile.Link)

# group: Pin
categories = Categories("OST_Walls")  # graph input
all_elements_of_category = ElementsOfCategory(Category=categories)  # frozen
pin_2 = Orchid.RevitProject.Elements.Element.Pin(element=all_elements_of_category)
unPin = Orchid.RevitProject.Elements.Element.UnPin(element=all_elements_of_category)

# group: Pin
categories_2 = Categories("OST_Walls")  # graph input
all_elements_of_category_2 = ElementsOfCategory(Category=categories_2)  # frozen
pin_3 = Orchid.RevitProject.Elements.Element.Pin()
unPin_2 = Orchid.RevitProject.Elements.Element.UnPin()
