# Dynamo graph Location.dyn (Dynamo 2.3.1.11775)
# packages: Orchid 203.3.0.8042

# group: Project location
project_origin = Origin("Internal")  # graph input
getVector = Orchid.RevitProject.Common.Location.GetVector(location=project_origin)
watch = Watch(getVector)
getPoint = Orchid.RevitProject.Common.Location.GetPoint(location=project_origin)
watch_2 = Watch(getPoint)
set = Orchid.RevitProject.Common.Location.Set(location=project_origin)
watch_3 = Watch(set)
get = Orchid.RevitProject.Common.Location.Get()
watch_4 = Watch(get)
name = Element.Name(element=get)
watch_5 = Watch(name)

# group: Project phase
phases = Phase("New Construction")  # graph input
watch_6 = Watch(phases)
