# Dynamo graph Purge_R23.dyn "Purge" (Dynamo 2.16.1.2727)
# packages: Orchid 216.3.0.5794

# group: Imported dwg files etc.
purge = Orchid.RevitProject.Common.Imports.Purge()
code_block = CodeBlock { "ImportInstance"; }  # frozen
byName = Orchid.RevitProject.Elements.Class.ByName(name=code_block)
ofClass = Orchid.RevitProject.Elements.Element.OfClass(class=byName)
delete = Orchid.RevitProject.Elements.Element.Delete(element=ofClass)

# group: Imported lines from dwg files etc.
deleteImported = Orchid.RevitProject.Categories.Category.DeleteImported()
code_block_2 = CodeBlock { "Imports in Families"; }  # frozen
byName_2 = Category.ByName(name=code_block_2)
byCategory = Orchid.RevitProject.Categories.SubCategory.ByCategory(category=byName_2)
delete_2 = Orchid.RevitProject.Categories.SubCategory.Delete(category=byName_2, subCategory=byCategory)
imported = Orchid.RevitProject.Categories.Category.Imported()  # frozen
delete_3 = Orchid.RevitProject.Elements.Element.Delete(element=imported)

boolean = BoolSelector(true)  # graph input
purge_2 = Orchid.RevitProject.Common.Document.Purge(completely=boolean)

# group: 
# All is included in Document.Purge
purge_3 = Orchid.RevitProject.Views.ViewTemplate.Purge()  # frozen
purge_4 = Orchid.Geometry.LineStyle.Purge()  # frozen
purge_5 = Orchid.Geometry.LinePattern.Purge()  # frozen
purge_6 = Orchid.RevitProject.Parameters.ProjectParameter.Purge()  # frozen
purge_7 = Orchid.RevitProject.Filters.ParameterFilter.Purge()  # frozen

# group: 
# All is included in Document.Purge
purge_8 = Orchid.RevitMaterial.Material.Purge()  # frozen
purge_9 = Orchid.RevitMaterial.Visual.Asset.Purge()  # frozen

boolean_2 = BoolSelector(true)  # graph input
purge_10 = Orchid.RevitFamily.FamilyDocument.Purge(completely=boolean_2)  # frozen
purge_11 = Orchid.RevitProject.Views.Sheet.Purge()

# group: PostCommand
boolean_3 = BoolSelector(false)  # graph input
purge_12 = Orchid.RevitProject.Common.PostCommand.Purge(activate=boolean_3)  # frozen
