# Dynamo graph StartingView.dyn (Dynamo 2.16.1.2727)
# packages: Orchid 216.3.0.5799

views = Views("{3D}")  # graph input
setStartingView = Orchid.RevitProject.Common.Document.SetStartingView(view=views)
watch = Watch(setStartingView)
