# Dynamo graph moveToOrigin_Worksets.dyn (Dynamo 2.3.2.15696)
# packages: Orchid 203.3.0.8042, Orchid 203.3.0.8048, Orchid 203.3.1.8281

# group: new origin -> as vector
select_model_element = DSModelElementSelection()  # 1 picked in the model; graph input
getLocation = Element.GetLocation(element=select_model_element)
reverse = Orchid.Common.Geometry.Point.Reverse(point=getLocation)

# group: Write coordinate to txt file and copy coordinate to clipboard
current = Orchid.RevitProject.Common.Document.Current()
boolean = BoolSelector(false)
path = Orchid.RevitProject.Common.Document.Path(document=current, withExtension=boolean)
code_block = CodeBlock(file=path) { file+".txt"; }
string_from_object = FromObject(obj=reverse)
writeText = FileSystem.WriteText(filePath=code_block, text=string_from_object)
copyTo = Orchid.Common.Clipboard.CopyTo(object=reverse)

# group: Adjust view crop box
modelAll = Orchid.RevitProject.Views.View.ModelAll()
move = Orchid.RevitProject.Views.View.Move(view=modelAll, point=reverse)

# group: Adjust sectionsbox
threeD = Orchid.RevitProject.Views.View.ThreeD()
moveSectionBox = Orchid.RevitProject.Views.View.MoveSectionBox(view3D=threeD, point=reverse)

# group: Set workset ownership
all = Orchid.RevitProject.Common.Workset.All()
setOwner = Orchid.RevitProject.Common.Workset.SetOwner(workset=all)

# group: Select elements
code_block_2 = CodeBlock()
# ---------- code_block_2.designscript (2 lines) ----------
// Category type elements
"Model";
# ----------------------------------------
await_ = Orchid.Common.DataStream.Await(pass=code_block_2, waitFor=setOwner)
elementByCategoryType = Orchid.RevitProject.Elements.Selection.ElementByCategoryType(categoryType=await_)
string_from_object_2 = FromObject(obj=elementByCategoryType.Category)
code_block_3 = CodeBlock()
# ---------- code_block_3.designscript (2 lines) ----------
// Filter for Curtain elements
"Curtain";
# ----------------------------------------
contains = String.Contains(str=string_from_object_2, searchFor=code_block_3)
filterByBoolMask = List.FilterByBoolMask(list=elementByCategoryType.Element, mask=contains)
allStackedWall = Orchid.RevitProject.Elements.Wall.AllStackedWall()
all_2 = Orchid.RevitProject.Elements.Sweep.All()
allSeparationLine = Orchid.RevitProject.Elements.SpatialElement.AllSeparationLine()
flatten = List.Flatten(list=allSeparationLine.Element)
join = List.Join(list0=filterByBoolMask.out, list1=allStackedWall, list2=all_2, list3=flatten)

# group: Select special elements
code_block_4 = CodeBlock { "MultistoryStairs"; }
byName = Orchid.RevitProject.Elements.Types.ByName(name=code_block_4)
all_elements_of_type = ElementsOfType(element_type=byName)
all_3 = Orchid.RevitProject.Datums.ReferencePlane.All()
all_4 = Orchid.RevitProject.Datums.Level.All()
all_5 = Orchid.RevitProject.Datums.Grid.All()
allModel = Orchid.RevitProject.Elements.Group.AllModel()
join_2 = List.Join(list0=all_elements_of_type, list1=all_3, list2=all_4, list3=all_5, list4=allModel)

# group: Select elements
code_block_5 = CodeBlock()
# ---------- code_block_5.designscript (2 lines) ----------
// Category type elements
"Annotation";
# ----------------------------------------
elementByCategoryType_2 = Orchid.RevitProject.Elements.Selection.ElementByCategoryType(categoryType=code_block_5)
code_block_6 = CodeBlock(category=elementByCategoryType_2.Category)
# ---------- code_block_6.designscript (3 lines) ----------
category.Name == "Section Boxes" ||
category.Name == "Revision Clouds"
? true : false;
# ----------------------------------------
filterByBoolMask_2 = List.FilterByBoolMask(list=elementByCategoryType_2.Element, mask=code_block_6)

# group: Select additional elements that not can be grouped
allDetail = Orchid.RevitProject.Elements.Group.AllDetail()
ownerViewType = Orchid.RevitProject.Elements.Element.OwnerViewType(element=allDetail)
code_block_7 = CodeBlock(t=ownerViewType) { t != "Detail"? true : false; }
filterByBoolMask_3 = List.FilterByBoolMask(list=allDetail, mask=code_block_7)

# group: join lists and unpin element
join_3 = List.Join(list0=join, list1=join_2, list2=filterByBoolMask_2.out, list3=filterByBoolMask_3.in)
flatten_2 = List.Flatten(list=join_3)
clean = Orchid.Common.List.Clean(list=flatten_2)
isPinned = Orchid.RevitProject.Elements.Element.IsPinned(element=clean)
filterByBoolMask_4 = List.FilterByBoolMask(list=clean, mask=isPinned)
unPin = Orchid.RevitProject.Elements.Element.UnPin(element=filterByBoolMask_4.in)
isCopyMonitored = Orchid.RevitProject.Elements.Element.IsCopyMonitored(element=clean)
filterByBoolMask_5 = List.FilterByBoolMask(list=clean, mask=isCopyMonitored)
await_2 = Orchid.Common.DataStream.Await(pass=filterByBoolMask_5.out, waitFor=unPin)
move_2 = Orchid.RevitProject.Elements.Element.Move(element=await_2, point=reverse)

# group: re-pin elements
await_3 = Orchid.Common.DataStream.Await(pass=unPin, waitFor=move_2)
pin = Orchid.RevitProject.Elements.Element.Pin(element=await_3)

# group: Relinquish workset
relinquish = Orchid.RevitProject.Common.Workset.Relinquish(waitFor=move_2)

# group: Revisions -> delete or add
deleteAll = Orchid.RevitProject.Common.Revision.DeleteAll()  # frozen
all_6 = Orchid.RevitProject.Common.RevisionCloud.All()  # frozen
# note: If revisions is deleted, then remember to
# remove they are added to the "move" list
deleteAll_2 = Orchid.RevitProject.Common.RevisionCloud.DeleteAll()  # frozen

# group: Adjust sectionsbox
code_block_8 = CodeBlock { "ThreeD"; }
byName_2 = Orchid.RevitProject.Views.ViewType.ByName(name=code_block_8)
byType = Orchid.RevitProject.Views.View.ByType(viewType=byName_2)
watch = Watch(byType)
