# Dynamo graph Revit Application_R21.dyn "Revit Application" (Dynamo 2.12.1.8246)
# packages: Orchid 206.3.0.8040

o_revit_username = Orchid.Common.Revit.Username()
watch = Watch(o_revit_username)
o_revit_versionbuild = Orchid.Common.Revit.VersionBuild()
watch_2 = Watch(o_revit_versionbuild)
o_revit_version = Orchid.Common.Revit.Version()
watch_3 = Watch(o_revit_version)
o_revit_format = Orchid.Common.Revit.Format()
watch_4 = Watch(o_revit_format)
