# Dynamo graph Selection_R21.dyn "Selection" (Dynamo 2.12.1.8246)
# packages: Orchid 206.3.1.8223

# group: Selection by level
levels = Levels("Level 1")
boolean = BoolSelector(true)
o_selection_elementbylevel = Orchid.RevitProject.Elements.Selection.ElementByLevel(level=levels, spatial=boolean)
watch = Watch(o_selection_elementbylevel.Category)
watch_2 = Watch(o_selection_elementbylevel.Element)

# group: Model elements
o_selection_modelelement = Orchid.RevitProject.Elements.Selection.ModelElement()
watch_3 = Watch(o_selection_modelelement.Category)
watch_4 = Watch(o_selection_modelelement.Element)

# group: Family
o_family_all = Orchid.RevitProject.Elements.Family.All()
watch_5 = Watch(o_family_all.Category)
watch_6 = Watch(o_family_all.Family)
code_block = CodeBlock()
# ---------- code_block.designscript (2 lines) ----------
["Doors",
"Windows"];
# ----------------------------------------
byName = Category.ByName(name=code_block)
o_family_bycategory = Orchid.RevitProject.Elements.Family.ByCategory(category=byName)
watch_7 = Watch(o_family_bycategory)

natural_category_name = CodeBlock()
# ---------- natural_category_name.designscript (26 lines) ----------
[
"Casework",
"Ceilings",
"Columns",
"Curtain Wall Mullions",
"Curtain Panels",
"Curtain Systems",
"Doors",
"Entourage",
"Floors",
"Furniture",
"Furniture Systems",
"Generic Models",
"Plumbing Fixtures",
"Ramps",
"Roofs",
"Specialty Equipment",
"Stairs",
"Structural Columns",
"Structural Foundations",
"Structural Framing",
"Structural Beam Systems",
"Structural Stiffeners",
"Walls",
"Windows"
];
# ----------------------------------------

# group: Selection by element
o_selection_elementhasmaterial = Orchid.RevitProject.Elements.Selection.ElementHasMaterial()
watch_8 = Watch(o_selection_elementhasmaterial.Element)
watch_9 = Watch(o_selection_elementhasmaterial.Category)
o_selection_elementbycategory = Orchid.RevitProject.Elements.Selection.ElementByCategory(category=natural_category_name)
watch_10 = Watch(o_selection_elementbycategory.Category)
watch_11 = Watch(o_selection_elementbycategory.Element)

# group: OOTB nodes
byName_2 = Category.ByName(name=natural_category_name)
all_elements_of_category = ElementsOfCategory(Category=byName_2)
o_list_clean = Orchid.Common.List.Clean(list=all_elements_of_category)
watch_12 = Watch(o_list_clean)

# group: Converters
o_object_torevittype = Orchid.Common.Object.ToRevitType(object=byName_2)
o_object_todynamotype = Orchid.Common.Object.ToDynamoType(object=o_object_torevittype)
watch_13 = Watch(o_object_todynamotype)
type = Object.Type(object=o_object_todynamotype)
watch_14 = Watch(type)

# group: Selection by element type
boolean_2 = BoolSelector(false)
o_selection = Orchid.RevitProject.Elements.Selection.ElementTypeHasMaterial(library=boolean_2)
watch_15 = Watch(o_selection.Category)
watch_16 = Watch(o_selection.ElementType)

# group: Selection
o_selection_elementbyfamily = Orchid.RevitProject.Elements.Selection.ElementByFamily(family=o_family_bycategory)
watch_17 = Watch(o_selection_elementbyfamily)

# group: FamilyType
o_familytype_all = Orchid.RevitProject.Elements.FamilyType.All()
watch_18 = Watch(o_familytype_all.FamilyType)
watch_19 = Watch(o_familytype_all.Category)
code_block_2 = CodeBlock()  # same code as code_block
o_familytype_bycategory = Orchid.RevitProject.Elements.FamilyType.ByCategory(category=code_block_2)
watch_20 = Watch(o_familytype_bycategory)

code_block_3 = CodeBlock()
# ---------- code_block_3.designscript (9 lines) ----------
"Model";
"Annotation";
"AnalyticalModel";
"Internal";

["Model",
"Annotation",
"AnalyticalModel",
"Internal"];
# ----------------------------------------

# group: Selection by element type
boolean_3 = BoolSelector(false)
o_selection_2 = Orchid.RevitProject.Elements.Selection.ElementTypeByCategoryType(categoryType=code_block_3.out0, library=boolean_3)
watch_21 = Watch(o_selection_2.ElementType)
watch_22 = Watch(o_selection_2.CategoryType)
watch_23 = Watch(o_selection_2.Category)

code_block_4 = CodeBlock()
# ---------- code_block_4.designscript (3 lines) ----------
["Rooms",
"Spaces",
"Areas"];
# ----------------------------------------

# group: Converters Note: FamilyType in a project document is denoted FamilySymbol in Autodesk Revit API!
o_object_torevittype_2 = Orchid.Common.Object.ToRevitType(object=o_familytype_bycategory)
o_object_todynamotype_2 = Orchid.Common.Object.ToDynamoType(object=o_object_torevittype_2)
watch_24 = Watch(o_object_todynamotype_2)
name = Element.Name(element=o_object_todynamotype_2)
watch_25 = Watch(name)
watch_26 = Watch(o_object_torevittype_2)

built_in_categories = CodeBlock()
# ---------- built_in_categories.designscript (26 lines) ----------
[
"OST_Casework",
"OST_Ceilings",
"OST_Columns",
"OST_CurtainWallMullions",
"OST_CurtainWallPanels",
"OST_CurtaSystem",
"OST_Doors",
"OST_Entourage",
"OST_Floors",
"OST_Furniture",
"OST_FurnitureSystems",
"OST_GenericModel",
"OST_PlumbingFixtures",
"OST_Ramps",
"OST_Roofs",
"OST_SpecialityEquipment",
"OST_Stairs",
"OST_StructuralColumns",
"OST_StructuralFoundation",
"OST_StructuralFraming",
"OST_StructuralFramingSystem",
"OST_StructuralStiffener",
"OST_Walls",
"OST_Windows"
];
# ----------------------------------------

# group: Selection by element
o_selection_3 = Orchid.RevitProject.Elements.Selection.ElementByCategoryType(categoryType=code_block_3.out0)
watch_27 = Watch(o_selection_3.Element)
watch_28 = Watch(o_selection_3.CategoryType)
watch_29 = Watch(o_selection_3.Category)

# group: Deprecated converters
o_element_torevittype = Orchid.RevitProject.Elements.Element.ToRevitType(element=o_familytype_bycategory)
o_element_todynamotype = Orchid.RevitProject.Elements.Element.ToDynamoType(element=o_element_torevittype)
watch_30 = Watch(o_element_todynamotype)
watch_31 = Watch(o_element_torevittype)
name_2 = Element.Name(element=o_element_todynamotype)
watch_32 = Watch(name_2)
