# Dynamo graph TagLocation_R21.dyn "TagLocation" (Dynamo 2.3.1.11775)
# packages: Orchid 206.3.0.8042

# group: Set tag at element location
code_block = CodeBlock { ["Room Tags", "Door Tags"]; "Room Tags"; "Door Tags"; }
byName = Category.ByName(name=code_block.out0)
all_elements_of_category = ElementsOfCategory(Category=byName)
o_tag_movetohostlocation = Orchid.RevitProject.Annotations.Tag.MoveToHostLocation(tag=all_elements_of_category)

# group: Set tag at element location
code_block_2 = CodeBlock { ["Rooms", "Doors"]; "Rooms"; "Doors"; }
byName_2 = Category.ByName(name=code_block_2.out0)
all_elements_of_category_2 = ElementsOfCategory(Category=byName_2)
o_element_movetagtolocation = Orchid.RevitProject.Elements.Element.MoveTagToLocation(element=all_elements_of_category_2)  # frozen
