# Dynamo graph PDFexport_R22.dyn "PDFexport" (Dynamo 2.12.0.5650)
# packages: Orchid 212.4.0.5794

# group: Merge PDF files
code_block = CodeBlock()
# ---------- code_block.designscript (6 lines) ----------
//input documents
["%userprofile%\\Downloads\\PDF\\pdf1.pdf",
"%userprofile%\\Downloads\\PDF\\pdf2.pdf"];

//output file path
"%userprofile%\\Downloads\\PDF\\result.pdf";
# ----------------------------------------
o_file_mergepdf = Orchid.Common.File.MergePDF(documents=code_block.out0, filePath=code_block.out1)  # frozen

# group: Print current view (center and fit to page)
string = StringInput("testSetting")  # graph input
o_pdfexport_papersizes = PaperSize("<Use Sheet Size>")
o_print_paperplacement = PaperPlacement("Center")  # graph input
o_print_zoomtype = ZoomType("Fit To Page")  # graph input
o_pdfexport_createsetting = Orchid.Common.PDFexport.CreateSetting(name=string, paperZize=o_pdfexport_papersizes, paperPlacement=o_print_paperplacement, zoomType=o_print_zoomtype)
o_document_activeview = Orchid.RevitProject.Common.Document.ActiveView()
o_pdfexport_byview = Orchid.Common.PDFexport.ByView(view=o_document_activeview, exportSetting=o_pdfexport_createsetting)
# note: if export options there are rarely set need to be included, then connect:
# "Export.SetOptions" output ExportSetting to "Export.ByView" input exportSetting!
o_datastream_await = Orchid.Common.DataStream.Await(pass=o_pdfexport_createsetting, waitFor=o_pdfexport_byview)
o_pdfexport_deletesetting = Orchid.Common.PDFexport.DeleteSetting(exportSetting=o_datastream_await)

o_pdfexport_papersize = Orchid.Common.PDFexport.PaperSize()
watch = Watch(o_pdfexport_papersize)

# group: Print options there are rarely set
boolean = BoolSelector(true)  # graph input
boolean_2 = BoolSelector(false)  # graph input
o_print_rasterquality = RasterQuality("Medium")
o_print_colordepth = ColorDepthType("Gray Scale")  # graph input
o_pdfexport_setoptions = Orchid.Common.PDFexport.SetOptions(exportSetting=o_pdfexport_createsetting, viewLinksinBlue=boolean, hideReforWorkPlanes=boolean_2, hideUnreferencedViewTags=boolean, maskCoincidentLines=boolean, hideScopeBoxes=boolean_2, hideCropBoundaries=boolean_2, replaceHalftoneWithThinLines=boolean, createOutputUsing=boolean, rasterQuality=o_print_rasterquality, colorDepth=o_print_colordepth)  # frozen

# note: Export Setting may be set
# both as an element and
# as a string
string_2 = StringInput("Default")  # graph input
o_export_setting = Setting("Default")

# group: Remove print setting
# note: Export Setting may be set
# both as an element and
# as a string
string_3 = StringInput("testSetting")  # graph input
o_pdfexport_deletesetting_2 = Orchid.Common.PDFexport.DeleteSetting(exportSetting=string_3)  # frozen
o_export_setting_2 = Setting("testSetting")

o_sheet_set = SheetSet("A3 set")  # graph input
string_4 = StringInput("testSetting")  # graph input
o_pdfexport_createsetting_2 = Orchid.Common.PDFexport.CreateSetting(name=string_4)
o_pdfexport_papersizes_2 = PaperSize("ISO A3 : 297x420 mm")
o_print_pageorientation = PageOrientation("Portrait")  # graph input
o_print_paperplacement_2 = PaperPlacement("Lower Left")  # graph input
o_print_margintype = MarginType("User defined")  # graph input
code_block_2 = CodeBlock { [10,10]; }
o_print_zoomtype_2 = ZoomType("Zoom")  # graph input
code_block_3 = CodeBlock { 100; }
o_pdfexport_changesetting = Orchid.Common.PDFexport.ChangeSetting(exportSetting=o_pdfexport_createsetting_2, paperZize=o_pdfexport_papersizes_2, pageOrientation=o_print_pageorientation, paperPlacement=o_print_paperplacement_2, marginType=o_print_margintype, margin=code_block_2, zoomType=o_print_zoomtype_2, zoom=code_block_3)
o_sheetset_getview = Orchid.RevitProject.Views.SheetSet.GetView(viewSheetSet=o_sheet_set)

# group: filePath --> file name incl. path
boolean_3 = BoolSelector(false)  # graph input
o_pdfexport_quality = ExportQuality("DPI300")
o_directory_current = Orchid.Common.Directory.Current()
sheetNumber = Sheet.SheetNumber(sheet=o_sheetset_getview)
code_block_4 = CodeBlock(a=o_directory_current, b=sheetNumber) { a + "\\" + b; }

o_pdfexport_byviewsheetset = Orchid.Common.PDFexport.ByViewSheetSet(combine=boolean_3, viewSheetSet=o_sheet_set)  # frozen
o_pdfexport_byview_2 = Orchid.Common.PDFexport.ByView(fileName=code_block_4, combine=boolean_3, view=o_sheetset_getview)

# group: SheetSet
categories = Categories("OST_RampsAboveCut")  # graph input; frozen
all_elements_of_category = ElementsOfCategory(Category=categories)
string_5 = StringInput("testSet")  # graph input
o_sheetset_create = Orchid.RevitProject.Views.SheetSet.Create(view=all_elements_of_category, name=string_5)
o_sheetset_delete = Orchid.RevitProject.Views.SheetSet.Delete(viewSheetSet=o_sheetset_create)
o_sheetset_getview_2 = Orchid.RevitProject.Views.SheetSet.GetView(viewSheetSet=o_sheetset_create)
o_sheet_set_2 = SheetSet("A3 set")  # graph input
o_sheetset_change = Orchid.RevitProject.Views.SheetSet.Change(view=o_sheetset_getview_2, viewSheetSet=o_sheet_set_2)
