# Dynamo graph LinkedDocument_R22.dyn (Dynamo 2.12.1.8246)
# packages: Orchid 212.4.0.5826

# group: Get links by type
o_link_types = LinkType("Revit Link")
code_block = CodeBlock { "RevitLink"; }
o_link_getlinkbytype = Orchid.RevitProject.Common.Link.GetLinkByType(linkType=code_block)
watch = Watch(o_link_getlinkbytype)

# group: Link cad file
string = StringInput("%userprofile%\Programming\Testing\Data\Drawing1.dwg")  # graph input
o_link_positioning = Positioning("Center")  # graph input
o_import_units = Unit("Millimeter")  # graph input
o_import_color_mode = ColorMode("BlackAndWhite")  # graph input
code_block_2 = CodeBlock { -1000; }
byCoordinates = Point.ByCoordinates(y=code_block_2)
o_model_views = ModelView("Level 1 (door)")  # graph input
boolean = BoolSelector(false)  # graph input
o_link_setcadfile = Orchid.RevitProject.Common.Link.SetCadFile(file=string, positioning=o_link_positioning, unit=o_import_units, colorMode=o_import_color_mode, referencePoint=byCoordinates, view=o_model_views, orientToView=boolean)
watch_2 = Watch(o_link_setcadfile.Instance)
watch_3 = Watch(o_link_setcadfile.Link)

# group: Link revit file
# note: File: defaultProject
# Output: LinkedProject
string_2 = StringInput("%userprofile%\Programming\Testing\Data\2022_Data\defaultBuilding.rvt")  # graph input
o_link_positioning_2 = Positioning("Origin")  # graph input
code_block_3 = CodeBlock { 10000; }
byCoordinates_2 = Point.ByCoordinates(y=code_block_3)
o_attachment_types = AttachmentType("Overlay")  # graph input
o_path_types = PathType("Relative")
o_link_setrevitfile = Orchid.RevitProject.Common.Link.SetRevitFile(file=string_2, positioning=o_link_positioning_2, referencePoint=byCoordinates_2, attachmentType=o_attachment_types, pathType=o_path_types)
watch_4 = Watch(o_link_setrevitfile.Link)
watch_5 = Watch(o_link_setrevitfile.Instance)

# group: Get all links
o_link_getlink = Orchid.RevitProject.Common.Link.GetLink()
watch_6 = Watch(o_link_getlink.Type)
watch_7 = Watch(o_link_getlink.Link)

# group: Dropdown selector
o_links = Links("Standard")  # graph input
watch_8 = Watch(o_links)
o_revit_links = RevitLinks("defaultBuilding.rvt")
watch_9 = Watch(o_revit_links)
o_cad_links = CadLinks("Drawing1")
watch_10 = Watch(o_cad_links)

# group: Revit links
o_path_types_2 = PathType("Relative")
o_link_getrevitlink = Orchid.RevitProject.Common.Link.GetRevitLink()
name = Element.Name(element=o_link_getrevitlink)
watch_11 = Watch(name)
o_link_reload = Orchid.RevitProject.Common.Link.Reload(link=o_link_getrevitlink)
watch_12 = Watch(o_link_getrevitlink)
o_link_unload = Orchid.RevitProject.Common.Link.Unload(link=o_link_getrevitlink)  # frozen
string_3 = StringInput("defaultBuilding.rvt")  # graph input
o_link_repath = Orchid.RevitProject.Common.Link.Repath(link=o_link_getrevitlink, file=string_3)  # frozen

# group: Link cad file
string_4 = StringInput("%userprofile%\Programming\Testing\Data\Drawing1.dwg")  # graph input
code_block_4 = CodeBlock { -1000; }
byCoordinates_3 = Point.ByCoordinates(x=code_block_4, y=code_block_4)
o_model_views_2 = ModelView("Level 1 (door)")  # graph input
boolean_2 = BoolSelector(true)  # graph input
o_link_setcadfile_2 = Orchid.RevitProject.Common.Link.SetCadFile(file=string_4, referencePoint=byCoordinates_3, view=o_model_views_2, orientToView=boolean_2)  # frozen
watch_13 = Watch(o_link_setcadfile_2.Instance)
watch_14 = Watch(o_link_setcadfile_2.Link)

# group: CAD links
o_link_getcadlink = Orchid.RevitProject.Common.Link.GetCadLink()
watch_15 = Watch(o_link_getcadlink)
name_2 = Element.Name(element=o_link_getcadlink)
watch_16 = Watch(name_2)
o_link_reload_2 = Orchid.RevitProject.Common.Link.Reload(link=o_link_getcadlink)
watch_17 = Watch(o_link_reload_2)

# group: Convert to CAD link
select_model_element = DSModelElementSelection()  # nothing selected; graph input; frozen
watch_18 = Watch(select_model_element)
o_link_converttolink = Orchid.RevitProject.Common.Link.ConvertToLink(instance=select_model_element)
watch_19 = Watch(o_link_converttolink)

# group: Convert to Revit link
select_model_element_2 = DSModelElementSelection()  # nothing selected; graph input; frozen
watch_20 = Watch(select_model_element_2)
o_link_converttolink_2 = Orchid.RevitProject.Common.Link.ConvertToLink(instance=select_model_element_2)
watch_21 = Watch(o_link_converttolink_2)
