# Dynamo graph RotateByOrigin_R22.dyn (Dynamo 2.12.1.8246)
# packages: Orchid 212.4.0.5986

# group: Collect elements
code_block = CodeBlock()
# ---------- code_block.designscript (4 lines) ----------
// Revit enumeration
"CategoryType";
// Category type elements
"Model";
# ----------------------------------------
o_revit_enumbyname = Orchid.AdeskApp.Revit.EnumByName(enumType=code_block.out0, valueName=code_block.out1)
o_element_bycategorytype = Orchid.RevitProject.Elements.Element.ByCategoryType(categoryType=o_revit_enumbyname)
string_from_object = FromObject(obj=o_element_bycategorytype.Category)
code_block_2 = CodeBlock()
# ---------- code_block_2.designscript (2 lines) ----------
// Filter for Curtain elements
"Curtain";
# ----------------------------------------
contains = String.Contains(string=string_from_object, searchFor=code_block_2)
filterByBoolMask = List.FilterByBoolMask(list=o_element_bycategorytype.Element, mask=contains)
o_wall_stackedwalls = Orchid.RevitProject.Elements.Wall.StackedWalls()
o_sweep_indocument = Orchid.RevitProject.Elements.Sweep.InDocument()
o_spatialelement_separationlines = Orchid.RevitProject.Elements.SpatialElement.SeparationLines()
flatten = List.Flatten(list=o_spatialelement_separationlines.Element)
join = List.Join(list0=filterByBoolMask.out, list1=o_wall_stackedwalls, list2=o_sweep_indocument, list3=flatten)

# group: Collect special elements
code_block_3 = CodeBlock { "MultistoryStairs"; }
o_class_byname = Orchid.RevitProject.Elements.Class.ByName(name=code_block_3)
all_elements_of_type = ElementsOfType(element_type=o_class_byname)
o_referenceplane_indocument = Orchid.RevitProject.Datums.ReferencePlane.InDocument()
o_level_indocument = Orchid.RevitProject.Datums.Level.InDocument()
o_grid_indocument = Orchid.RevitProject.Datums.Grid.InDocument()
o_group_model = Orchid.RevitProject.Elements.Group.Model()
join_2 = List.Join(list0=all_elements_of_type, list1=o_referenceplane_indocument, list2=o_level_indocument, list3=o_grid_indocument, list4=o_group_model)

# group: Collect elements
code_block_4 = CodeBlock()
# ---------- code_block_4.designscript (4 lines) ----------
// Revit enumeration
"CategoryType";
// Category type elements
"Annotation";
# ----------------------------------------
o_revit_enumbyname_2 = Orchid.AdeskApp.Revit.EnumByName(enumType=code_block_4.out0, valueName=code_block_4.out1)
o_element_bycategorytype_2 = Orchid.RevitProject.Elements.Element.ByCategoryType(categoryType=o_revit_enumbyname_2)
code_block_5 = CodeBlock(category=o_element_bycategorytype_2.Category)
# ---------- code_block_5.designscript (3 lines) ----------
category.Name == "Section Boxes" ||
category.Name == "Revision Clouds"
? true : false;
# ----------------------------------------
filterByBoolMask_2 = List.FilterByBoolMask(list=o_element_bycategorytype_2.Element, mask=code_block_5)

# group: Collect additional elements that not can be grouped
o_group_detail = Orchid.RevitProject.Elements.Group.Detail()
o_element_ownerviewtype = Orchid.RevitProject.Elements.Element.OwnerViewType(element=o_group_detail)
code_block_6 = CodeBlock(t=o_element_ownerviewtype) { t != "Detail"? true : false; }
filterByBoolMask_3 = List.FilterByBoolMask(list=o_group_detail, mask=code_block_6)

# group: Collect linked instances
o_link_getcadlink = Orchid.RevitProject.Common.Link.GetCadLink()
o_link_getrevitlink = Orchid.RevitProject.Common.Link.GetRevitLink()
list_create = List.Create(item0=o_link_getcadlink, item1=o_link_getrevitlink)
o_link_instance = Orchid.RevitProject.Common.Link.Instance(link=list_create)
o_list_filterbynullmask = Orchid.Common.List.FilterByNullMask(list=o_link_instance, mask=o_link_instance)

# group: Project Origin
code_block_7 = CodeBlock()
# ---------- code_block_7.designscript (5 lines) ----------
Autodesk.Point.ByCoordinates(0, 0, 0);
// clockwise
-90;
// counter clockwise
90;
# ----------------------------------------

# group: join lists and unpin element
join_3 = List.Join(list0=join, list1=join_2, list2=filterByBoolMask_2.out, list3=filterByBoolMask_3.in, list4=o_list_filterbynullmask.in)
flatten_2 = List.Flatten(list=join_3)
o_list_clean = Orchid.Common.List.Clean(list=flatten_2)
o_element_ispinned = Orchid.RevitProject.Elements.Element.IsPinned(element=o_list_clean)
filterByBoolMask_4 = List.FilterByBoolMask(list=o_list_clean, mask=o_element_ispinned)
o_element_unpin = Orchid.RevitProject.Elements.Element.UnPin(element=filterByBoolMask_4.in)
o_element_iscopymonitored = Orchid.RevitProject.Elements.Element.IsCopyMonitored(element=o_list_clean)
filterByBoolMask_5 = List.FilterByBoolMask(list=o_list_clean, mask=o_element_iscopymonitored)
o_datastream_await = Orchid.Common.DataStream.Await(pass=filterByBoolMask_5.out, waitFor=o_element_unpin)
o_element_rotate = Orchid.RevitProject.Elements.Element.Rotate(element=o_datastream_await, point=code_block_7.out0, angle=code_block_7.out2)

# group: re-pin elements
o_datastream_await_2 = Orchid.Common.DataStream.Await(pass=o_element_unpin, waitFor=o_element_rotate)
o_element_pin = Orchid.RevitProject.Elements.Element.Pin(element=o_datastream_await_2)

# group: Adjust view crop box
o_view_model = Orchid.RevitProject.Views.View.Model()
o_view_rotate = Orchid.RevitProject.Views.View.Rotate(view=o_view_model, point=code_block_7.out0, angle=code_block_7.out2)

# group: Adjust sectionsbox
o_view_threed = Orchid.RevitProject.Views.View.ThreeD()
o_view_rotatesectionbox = Orchid.RevitProject.Views.View.RotateSectionBox(view3D=o_view_threed, point=code_block_7.out0, angle=code_block_7.out2)
