# Dynamo graph SheetViews_R22.dyn (Dynamo 2.12.1.8246)
# packages: Orchid 212.4.0.5821

# note: File: defaultProject
o_sheet_indocument = Orchid.RevitProject.Views.Sheet.InDocument()
o_sheet_content = Orchid.RevitProject.Views.Sheet.Content(sheet=o_sheet_indocument)
watch = Watch(o_sheet_content)
o_sheet_schedule = Orchid.RevitProject.Views.Sheet.Schedule(sheet=o_sheet_indocument)
watch_2 = Watch(o_sheet_schedule)
o_sheet_view = Orchid.RevitProject.Views.Sheet.View(sheet=o_sheet_indocument)
watch_3 = Watch(o_sheet_view)
flatten = List.Flatten(list=o_sheet_content)
watch_4 = Watch(flatten)
flatten_2 = List.Flatten(list=o_sheet_schedule)
watch_5 = Watch(flatten_2)
flatten_3 = List.Flatten(list=o_sheet_view)
watch_6 = Watch(flatten_3)
